# Grasshopper definition Test_5.gh (Grasshopper 1.0.8)
# plug-ins: RhinoCodePluginGH

srf = Surface(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)
srf_2 = Surface(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)
srf_3 = Surface(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)
X = UnitX(Factor=1)
unit = UnitVector(Vector="1,1,0")
Y = UnitY(Factor=1)
Z = UnitZ(Factor=1)
bbox = BoundingBox(Content=srf_3, Plane=PlaneXY(0, 0, 0))  # -> Box, Box_2
vrot = Rotate(Vector=X, Axis=Z, Angle="PI/2")
debrep = DeconstructBrep(Brep=bbox.Box)  # -> Faces, Edges, Vertices
item = ListItem(List=debrep.Vertices, Index=0, Wrap=True)
contour = Contour(Shape=srf_3, Point=item, Direction=X, Distance="10")

# ---- group: Need Developed
c_script = CSharpScript(RefPt=item, Srf=srf_3, UVec=X)  # -> out, PtArr; inputs RefPt: Point3d, Srf: Brep, UVec: Vector3d
# ---------- c_script: C# ----------
// Grasshopper Script Instance
#region Usings
using System;
using System.Linq;
using System.Collections;
using System.Collections.Generic;
using System.Drawing;

using Rhino;
using Rhino.Geometry;

using Grasshopper;
using Grasshopper.Kernel;
using Grasshopper.Kernel.Data;
using Grasshopper.Kernel.Types;
#endregion

public class Script_Instance : GH_ScriptInstance
{
    #region Notes
    /* 
      Members:
        RhinoDoc RhinoDocument
        GH_Document GrasshopperDocument
        IGH_Component Component
        int Iteration

      Methods (Virtual & overridable):
        Print(string text)
        Print(string format, params object[] args)
        Reflect(object obj)
        Reflect(object obj, string method_name)
    */
    #endregion

    private void RunScript(Point3d RefPt, Brep Srf, Vector3d UVec, ref object PtArr)
    {
        // Write your logic here
        PtArr = null;
    }
}
# ---------- end c_script ----------

# ----
# Reposition the intersection Points
division = Division(A="10", B=2)
contour_2 = CurveContour(Curve=contour, Point=item, Direction=vrot, Distance="10")  # -> Contours, Parameters
c_script_2 = CSharpScript(ReferPt=item, Unit=division, iPt=contour_2.Contours)  # -> out, simplify(oPt); inputs ReferPt: Point3d, Unit: Double, iPt: Point3d
# ---------- c_script_2: C# ----------
// Grasshopper Script Instance
#region Usings
using System;
using System.Linq;
using System.Collections;
using System.Collections.Generic;
using System.Drawing;

using Rhino;
using Rhino.Geometry;

using Grasshopper;
using Grasshopper.Kernel;
using Grasshopper.Kernel.Data;
using Grasshopper.Kernel.Types;
#endregion

public class Script_Instance : GH_ScriptInstance
{
    #region Notes
    /* 
      Members:
        RhinoDoc RhinoDocument
        GH_Document GrasshopperDocument
        IGH_Component Component
        int Iteration

      Methods (Virtual & overridable):
        Print(string text)
        Print(string format, params object[] args)
        Reflect(object obj)
        Reflect(object obj, string method_name)
    */
    #endregion

    private void RunScript(
	Point3d ReferPt,
	double Unit,
	Point3d iPt,
	ref object oPt)
    {
        // Write your logic here
        double RefZ = ReferPt.Z;
        double iPtZ = iPt.Z;
        while(true)
        {
            
            if(iPtZ >= RefZ && iPtZ < RefZ+Unit)
            {
                if(Math.Abs(iPtZ - RefZ) > Math.Abs(iPtZ - (RefZ+Unit)))
                    iPt.Z = RefZ+Unit;
                else
                    iPt.Z = RefZ;
                break;
            }

            else
            {
                RefZ += Unit;
            }
        }
        oPt = iPt;
    }
}
# ---------- end c_script_2 ----------
division_2 = Division(A="10", B="4")
box = CenterBox(Base=c_script_2.oPt, X=division_2, Y=division_2, Z=division_2)
pshift = ShiftPaths(Data=c_script_2.oPt, Offset=-1)
path_mapper = PathMapper(pshift, source="{x;x}", target="{x}")
c_script_3 = CSharpScript(PtsSet=path_mapper, UVec=X)  # -> out, U_0, U_1; inputs PtsSet: tree of Point3d, UVec: Vector3d
# ---------- c_script_3: C# ----------
// Grasshopper Script Instance
#region Usings
using System;
using System.Linq;
using System.Collections;
using System.Collections.Generic;
using System.Drawing;

using Rhino;
using Rhino.Geometry;

using Grasshopper;
using Grasshopper.Kernel;
using Grasshopper.Kernel.Data;
using Grasshopper.Kernel.Types;

#endregion

public class Script_Instance : GH_ScriptInstance
{
    #region Notes
    /* 
      Members:
        RhinoDoc RhinoDocument
        GH_Document GrasshopperDocument
        IGH_Component Component
        int Iteration

      Methods (Virtual & overridable):
        Print(string text)
        Print(string format, params object[] args)
        Reflect(object obj)
        Reflect(object obj, string method_name)
    */
    #endregion

    private void RunScript(
	DataTree<Point3d> PtsSet,
	Vector3d UVec,
	ref object U_0,
	ref object U_1)
    {
        // Write your logic here
        double Angle = - Vector3d.VectorAngle(UVec, Vector3d.XAxis);
        var NewPtsSet = new DataTree<Point3d>();
        for(int i = 0; i < PtsSet.BranchCount; i++)
        {
            var RoTS = Transform.Rotation(Angle, Point3d.Origin);
            var PtList = PtsSet.Branch(i);
            PtList = PtList.Select(x => {
                x.Transform(RoTS); 
                return new Point3d(Math.Round(x.X,3), Math.Round(x.Y,3),0);
            }).ToList();
            NewPtsSet.AddRange(PtList, new GH_Path(i));
        }

        var XArr = new List<double>();
        var YArr = new List<double>();
       
        for(int i = 0; i < NewPtsSet.BranchCount; i++)
            for(int j = 0; j < NewPtsSet.Branch(i).Count; j++ )
            {
                var Pt = NewPtsSet.Branch(i)[j];
                if(!XArr.Contains(Math.Round(Pt.X,3)))
                    XArr.Add(Math.Round(Pt.X,3));
                if(!YArr.Contains(Math.Round(Pt.Y,3)))
                    YArr.Add(Math.Round(Pt.Y,3));
            }

        XArr.Sort();
        YArr.Sort();

        var PatternList = new DataTree<(Point3d,bool)>();
        var CheckPt = new List<Point3d>();
        foreach (var PtsList in NewPtsSet.Branches )
            CheckPt.AddRange(PtsList.Select(x => new Point3d(
                Math.Round(x.X,3), Math.Round(x.Y,3), 0)));

        for(int i = 0; i < XArr.Count; i++)
        {
            var PtYArrPattern = new (Point3d,bool)[YArr.Count];
            for(int j = 0; j < YArr.Count; j++)
            {
                bool Pattern = false;
                if(i%2 == 0 && j %2 == 0)
                    Pattern = !Pattern;
                else if(i%2==1 && j % 2==1)
                    Pattern = !Pattern;

                var TempPt = new Point3d(XArr[i], YArr[j],0);
                if(CheckPt.Contains(TempPt))
                {
                    PtYArrPattern[j] = (TempPt,Pattern);
                }
                else
                {
                    PtYArrPattern[j] = (Point3d.Unset, Pattern);
                }
            }
            PatternList.AddRange(PtYArrPattern, new GH_Path(i));
        }

        var OddPt = new DataTree<Point3d>();
        var EvenPt = new DataTree<Point3d>();
        var Indices = new List<int>();
        for(int i = 0; i < XArr.Count; i++)
        {
            var item = PatternList.Branch(i);
            for(int j = 0; j < YArr.Count; j++)
            {
                var Index = Find(NewPtsSet.Branch(i), item[j].Item1);
                Indices.Add(Index);
                if(Index != -1)
                {
                    if(item[j].Item2)
                        OddPt.Add(PtsSet.Branch(i)[Index], PtsSet.Path(i));
                    else
                        EvenPt.Add(PtsSet.Branch(i)[Index], PtsSet.Path(i));
                }
            }
        }

        U_0 = EvenPt;
        U_1 = OddPt;
    }

    public int Find(IEnumerable<Point3d> AEnum, Point3d item)
    {
        var AList = AEnum.ToList();
        for(int i = 0; i < AList.Count; i++)
        {
            if(AList[i] == item)
                return i;
        }
        return -1;
    }
}
# ---------- end c_script_3 ----------
pt = Point(path_mapper)
points = PointList(Points=pt, Size="10")
c_script_4 = CSharpScript(PtsSet=path_mapper, UVec=X)  # -> out, U_0, U_1, U_Pattern, V_0, V_1, V_Pattern; inputs PtsSet: tree of Point3d, UVec: Vector3d
# ---------- c_script_4: C# ----------
// Grasshopper Script Instance
#region Usings
using System;
using System.Linq;
using System.Collections;
using System.Collections.Generic;
using System.Drawing;

using Rhino;
using Rhino.Geometry;

using Grasshopper;
using Grasshopper.Kernel;
using Grasshopper.Kernel.Data;
using Grasshopper.Kernel.Types;
#endregion

public class Script_Instance : GH_ScriptInstance
{
    #region Notes
    /* 
      Members:
        RhinoDoc RhinoDocument
        GH_Document GrasshopperDocument
        IGH_Component Component
        int Iteration

      Methods (Virtual & overridable):
        Print(string text)
        Print(string format, params object[] args)
        Reflect(object obj)
        Reflect(object obj, string method_name)
    */
    #endregion

    private void RunScript(
	DataTree<Point3d> PtsSet,
	Vector3d UVec,
	ref object U_0,
	ref object U_1,
	ref object U_Pattern,
	ref object V_0,
	ref object V_1,
	ref object V_Pattern)
    {
        // Write your logic here
        //var VDir = FlipPoints(PtsSet, UVec, out _);

        var DirU_0 = new DataTree<Point3d>(); 
        var DirU_1 = new DataTree<Point3d>();
        var DirU_Pattern = new DataTree<bool>();

        var DirV_0 = new DataTree<Point3d>(); 
        var DirV_1 = new DataTree<Point3d>();
        var DirV_Pattern = new DataTree<bool>();

        FindPattern(PtsSet, UVec, ref DirU_0, ref DirU_1, ref DirU_Pattern);

        U_0 = DirU_0;
        U_1 = DirU_1;
        U_Pattern = DirU_Pattern;
        var PtsSetV = FlipPoints(PtsSet, UVec, out var SplitHint);
        var VVec = new Vector3d(UVec);
        VVec.Rotate(Math.PI * 0.5, Vector3d.ZAxis);
        FindPattern(PtsSetV, VVec, ref DirV_0, ref DirV_1, ref DirV_Pattern, true, SplitHint);
        V_0 = DirV_0;
        V_1 = DirV_1;
        V_Pattern = DirV_Pattern;
    }
    public void FindPattern(
        DataTree<Point3d> PtsSet, 
    Vector3d UVec, 
    ref DataTree<Point3d> Dir_0, 
    ref DataTree<Point3d> Dir_1, 
    ref DataTree<bool> Dir_Pattern, 
    bool Inverse = true,
    List<List<int>> SplitHint = null
    )
    {
        Dir_0 = new DataTree<Point3d>();
        Dir_1 = new DataTree<Point3d>();
        Dir_Pattern = new DataTree<bool>();

        double Angle = -Vector3d.VectorAngle(UVec, Vector3d.XAxis);
        var XArr = new List<double>();
        var YArr = new List<double>();
        var CheckPtList = new List<Point3d>();
        var PtList = new List<Point3d>();
        var RoTS = Transform.Rotation(Angle, Point3d.Origin);

        for(int i = 0; i < PtsSet.BranchCount; i++)
        {
            for(int j =0; j < PtsSet.Branch(i).Count; j++)
            {
                Point3d TempPt;
                
                PtList.Add(TempPt = PtsSet.Branch(i)[j]);
                TempPt.Transform(RoTS);
                if(!XArr.Contains(Math.Round(TempPt.X, 3)))
                    XArr.Add(Math.Round(TempPt.X,3));
                if(!YArr.Contains(Math.Round(TempPt.Y, 3)))
                    YArr.Add(Math.Round(TempPt.Y, 3));
                CheckPtList.Add(new Point3d(
                    Math.Round(TempPt.X,3),
                    Math.Round(TempPt.Y,3),
                    0
                ));
            }
        }

        XArr.Sort();
        YArr.Sort();
        var Dist = 2 * (XArr[1] - XArr[0]);

        var ComparePt0 = new Point3d(PtsSet.Branch(0)[0]);
        var ComparePt1 = new Point3d(PtsSet.Branch(0)[1]);

        ComparePt0.Transform(RoTS);
        ComparePt1.Transform(RoTS);
        double Xvar, Yvar;
        if(Math.Abs(Xvar = ComparePt0.X - ComparePt1.X) > Math.Abs(Yvar = ComparePt0.Y - ComparePt1.Y))
        {
             if(Xvar > 0)
                XArr.Reverse();
        }
        else
        {
            if(Yvar > 0)
                YArr.Reverse();
        }

        for(int i = 0; i < XArr.Count; i++)
        {
            var PtDArrPattern_0 = new List<Point3d>();
            var PtDArrPattern_1 = new List<Point3d>();
            var BoolPattern = new List<bool>();
            for(int j = 0; j < YArr.Count; j++)
            {
                bool Pattern = Inverse ? false : true;
                if(i%2 == 0 && j %2 == 0)
                    Pattern = !Pattern;
                else if(i%2==1 && j % 2==1)
                    Pattern = !Pattern;


                var TempPt = new Point3d(XArr[i], YArr[j], 0);
                if(CheckPtList.Contains(TempPt))
                {
                    var Index = Find(CheckPtList, TempPt);
                    if(Pattern)
                        PtDArrPattern_0.Add(PtList[Index]);
                    else
                        PtDArrPattern_1.Add(PtList[Index]);
                    BoolPattern.Add(Pattern);
                }
            }
            Dir_0.AddRange(PtDArrPattern_0, new GH_Path(i));
            Dir_1.AddRange(PtDArrPattern_1, new GH_Path(i));
            Dir_Pattern.AddRange(BoolPattern, new GH_Path(i));
        }
        Dir_0 = SplitTree(Dir_0, Dist, out _);
        Dir_1 = SplitTree(Dir_1, Dist, out _);

        if(SplitHint != null)
            Dir_Pattern = SplitTree<bool>(Dir_Pattern, SplitHint);
    }
    public DataTree<T> SplitTree<T>(DataTree<T> Trees, List<List<int>> Split)
    {
        var NewSplitTree = new DataTree<T>();
        int PathCount = 0;
        if(Trees.BranchCount != Split.Count) return Trees;

        for(int i = 0 ; i < Split.Count; i++)
        {
            if(Split[i].Count == 0)
                NewSplitTree.AddRange(Trees.Branch(i), new GH_Path(PathCount));
            else
            {
                foreach(var index in Split[i])
                {
                    var TempList = new List<T>();
                    for(int k = 0; k < Trees.Branch(i).Count; k++)
                    {
                        if(k == index)
                        {
                            NewSplitTree.AddRange(TempList, new GH_Path(PathCount));
                            PathCount++;
                            TempList = new List<T>();
                            TempList.Add(Trees.Branch(i)[k]);
                        }
                        else
                            TempList.Add(Trees.Branch(i)[k]);
                }
                    NewSplitTree.AddRange(TempList, new GH_Path(PathCount));
                }
            }
            PathCount++;
        }
        return NewSplitTree;
    }
    public DataTree<Point3d> FlipPoints(DataTree<Point3d> PtsSet, Vector3d UVec, out List<List<int>> SplitHint)
    {
        double Angle = -Vector3d.VectorAngle(UVec, Vector3d.XAxis);
        var XArr = new List<double>();
        var YArr = new List<double>();
        var CheckPtList = new List<Point3d>();
        var PtList = new List<Point3d>();
        for(int i = 0; i < PtsSet.BranchCount; i++ )
        {
            for(int j = 0; j < PtsSet.Branch(i).Count; j++)
            {
                var TempPt = PtsSet.Branch(i)[j];
                PtList.Add(PtsSet.Branch(i)[j]);
                var RoTS = Transform.Rotation(Angle, Point3d.Origin);
                TempPt.Transform(RoTS);

                if(!XArr.Contains(Math.Round(TempPt.X,3)))
                    XArr.Add(Math.Round(TempPt.X,3));
                if(!YArr.Contains(Math.Round(TempPt.Y,3)))
                    YArr.Add(Math.Round(TempPt.Y, 3));
                CheckPtList.Add(new Point3d(
                    Math.Round(TempPt.X,3),
                    Math.Round(TempPt.Y,3),
                    0
                ));
                
            }
        }
        XArr.Sort();
        YArr.Sort();
        var Distance = XArr[1]-XArr[0];

        //Flip tree into branches based on the Coordinate
        var NewTree = new DataTree<Point3d>();
        for(int i = 0; i < YArr.Count; i++)
        {
            var TempList = new List<Point3d>();
            for(int j = 0; j < XArr.Count;j++)
            {
                if(CheckPtList.Contains(new Point3d(XArr[j], YArr[i], 0)))
                {
                    var Index = Find(CheckPtList,new Point3d(XArr[j], YArr[i], 0));
                    TempList.Add(PtList[Index]);
                }
            }
            NewTree.AddRange(TempList, new GH_Path(i));
        }

        //Check the continumm of the point list in the tree
        /*
        var NewSplitTree = new DataTree<Point3d>();
        int PathCount = 0;
        for(int i = 0; i < NewTree.BranchCount; i++ )
        {
            var PtListsTest = NewTree.Branch(i);
            List<int> SplitIndices = new List<int>();
            var TestPt = new Point3d(PtListsTest[0]);
            TestPt.Z = 0;
            for(int j = 1; j < PtListsTest.Count-1; j++)
            {
                var TestPt2 = new Point3d(PtListsTest[j]);
                TestPt2.Z = 0;
                if(TestPt.DistanceTo(TestPt2) > Distance * 1.1) 
                    SplitIndices.Add(j); //<-split after j
                TestPt = TestPt2;
            }
            
            if(SplitIndices.Count == 0)
                NewSplitTree.AddRange(PtListsTest, new GH_Path(PathCount));
            else
            {
                
                var TempList = new List<Point3d>();
                foreach (var Index in SplitIndices)
                {
                    for(int k = 0; k < PtListsTest.Count; k++)
                {
                    if(k == SplitIndices[0]) 
                    {
                        NewSplitTree.AddRange(TempList, new GH_Path(PathCount));
                        PathCount++;
                        TempList = new List<Point3d>();
                    }
                    else
                        TempList.Add(PtListsTest[k]);
                }
                NewSplitTree.AddRange(TempList, new GH_Path(PathCount));
                }
                
            }
            PathCount++;
        }
*/
        return SplitTree(NewTree, Distance, out SplitHint);
    }
    public DataTree<Point3d> SplitTree(DataTree<Point3d> NewTree, double Distance, out List<List<int>> SplitArr)
    {
        var NewSplitTree = new DataTree<Point3d>();
        int PathCount = 0;
        SplitArr = new List<List<int>>();
        for(int i = 0; i < NewTree.BranchCount; i++ )
        {
            if(NewTree.Branch(i).Count < 1) continue;
            var PtListsTest = NewTree.Branch(i);
            List<int> SplitIndices = new List<int>();
            var TestPt = new Point3d(PtListsTest[0]);
            TestPt.Z = 0;
            for(int j = 1; j < PtListsTest.Count; j++)
            {
                var TestPt2 = new Point3d(PtListsTest[j]);
                TestPt2.Z = 0;
                if(TestPt.DistanceTo(TestPt2) > Distance * 1.1) 
                    SplitIndices.Add(j); //<-split after j
                TestPt = TestPt2;
            }
            SplitArr.Add(SplitIndices);
            if(SplitIndices.Count == 0)
                NewSplitTree.AddRange(PtListsTest, new GH_Path(PathCount));
            else
            {
                
                foreach (var Index in SplitIndices)
                {
                    var TempList = new List<Point3d>();
                    for(int k = 0; k < PtListsTest.Count; k++)
                    {
                        if(k == Index) 
                        {
                            NewSplitTree.AddRange(TempList, new GH_Path(PathCount));
                            PathCount++;
                            TempList = new List<Point3d>();
                            TempList.Add(PtListsTest[k]);
                        }
                        else
                            TempList.Add(PtListsTest[k]);
                    }
                    NewSplitTree.AddRange(TempList, new GH_Path(PathCount));
                }
                
            }
            PathCount++;
        }
        return NewSplitTree;
    }
    public int Find(IEnumerable<Point3d> AEnum, Point3d item)
    {
        var AList = AEnum.ToList();
        for(int i = 0; i < AList.Count; i++)
        {
            if(AList[i] == item)
                return i;
        }
        return -1;
    }
}
# ---------- end c_script_4 ----------
c_script_5 = CSharpScript(PtsSet=path_mapper, UVec=X)  # -> out, U_0, U_1, U_Pattern, V_0, V_1, V_Pattern; inputs PtsSet: tree of Point3d, UVec: Vector3d
# ---------- c_script_5: C# ----------
// Grasshopper Script Instance
#region Usings
using System;
using System.Linq;
using System.Collections;
using System.Collections.Generic;
using System.Drawing;

using Rhino;
using Rhino.Geometry;

using Grasshopper;
using Grasshopper.Kernel;
using Grasshopper.Kernel.Data;
using Grasshopper.Kernel.Types;
#endregion

public class Script_Instance : GH_ScriptInstance
{
    #region Notes
    /* 
      Members:
        RhinoDoc RhinoDocument
        GH_Document GrasshopperDocument
        IGH_Component Component
        int Iteration

      Methods (Virtual & overridable):
        Print(string text)
        Print(string format, params object[] args)
        Reflect(object obj)
        Reflect(object obj, string method_name)
    */
    #endregion

    private void RunScript(
	DataTree<Point3d> PtsSet,
	Vector3d UVec,
	ref object U_0,
	ref object U_1,
	ref object U_Pattern,
	ref object V_0,
	ref object V_1,
	ref object V_Pattern)
    {
        // Write your logic here
        var VDir = FlipPoints(PtsSet, UVec);
        var DirU_0 = new DataTree<Point3d>(); 
        var DirU_1 = new DataTree<Point3d>();
        var DirU_Pattern = new DataTree<bool>();

        var DirV_0 = new DataTree<Point3d>(); 
        var DirV_1 = new DataTree<Point3d>();
        var DirV_Pattern = new DataTree<bool>();

        FindPattern(PtsSet, UVec, ref DirU_0, ref DirU_1, ref DirU_Pattern);

        U_0 = DirU_0;
        U_1 = DirU_1;
        U_Pattern = DirU_Pattern;
        var PtsSetV = FlipPoints(PtsSet, UVec);
        var VVec = new Vector3d(UVec);
        VVec.Rotate(Math.PI * 0.5, Vector3d.ZAxis);
        FindPattern(PtsSetV, VVec, ref DirV_0, ref DirV_1, ref DirV_Pattern, false);
        V_0 = DirV_0;
        V_1 = DirV_1;
        V_Pattern = DirV_Pattern;
    }
    public void FindPattern(DataTree<Point3d> PtsSet, Vector3d UVec, ref DataTree<Point3d> Dir_0, ref DataTree<Point3d> Dir_1, ref DataTree<bool> Dir_Pattern, bool Inverse = true)
    {
        Dir_0 = new DataTree<Point3d>();
        Dir_1 = new DataTree<Point3d>();
        Dir_Pattern = new DataTree<bool>();

        double Angle = -Vector3d.VectorAngle(UVec, Vector3d.XAxis);
        var XArr = new List<double>();
        var YArr = new List<double>();
        var CheckPtList = new List<Point3d>();
        var PtList = new List<Point3d>();

        for(int i = 0; i < PtsSet.BranchCount; i++)
        {
            for(int j =0; j < PtsSet.Branch(i).Count; j++)
            {
                Point3d TempPt;
                var RoTS = Transform.Rotation(Angle, Point3d.Origin);
                PtList.Add(TempPt = PtsSet.Branch(i)[j]);
                TempPt.Transform(RoTS);

                if(!XArr.Contains(Math.Round(TempPt.X, 3)))
                    XArr.Add(Math.Round(TempPt.X,3));
                if(!YArr.Contains(Math.Round(TempPt.Y, 3)))
                    YArr.Add(Math.Round(TempPt.Y, 3));
                CheckPtList.Add(new Point3d(
                    Math.Round(TempPt.X,3),
                    Math.Round(TempPt.Y,3),
                    0
                ));
            }
        }

        XArr.Sort();
        YArr.Sort();

        for(int i = 0; i < XArr.Count; i++)
        {
            var PtDArrPattern_0 = new List<Point3d>();
            var PtDArrPattern_1 = new List<Point3d>();
            var BoolPattern = new List<bool>();
            for(int j = 0; j < YArr.Count; j++)
            {
                bool Pattern = Inverse ? false : true;
                if(i%2 == 0 && j %2 == 0)
                    Pattern = !Pattern;
                else if(i%2==1 && j % 2==1)
                    Pattern = !Pattern;

                var TempPt = new Point3d(XArr[i], YArr[j], 0);
                if(CheckPtList.Contains(TempPt))
                {
                    var Index = Find(CheckPtList, TempPt);
                    if(Pattern)
                        PtDArrPattern_0.Add(PtList[Index]);
                    else
                        PtDArrPattern_1.Add(PtList[Index]);
                    BoolPattern.Add(Pattern);
                }
            }
            Dir_0.AddRange(PtDArrPattern_0, new GH_Path(i));
            Dir_1.AddRange(PtDArrPattern_1, new GH_Path(i));
            Dir_Pattern.AddRange(BoolPattern, new GH_Path(i));
        }

    }

    public DataTree<Point3d> FlipPoints(DataTree<Point3d> PtsSet, Vector3d UVec)
    {
        double Angle = -Vector3d.VectorAngle(UVec, Vector3d.XAxis);
        var XArr = new List<double>();
        var YArr = new List<double>();
        var CheckPtList = new List<Point3d>();
        var PtList = new List<Point3d>();
        for(int i = 0; i < PtsSet.BranchCount; i++ )
        {
            for(int j = 0; j < PtsSet.Branch(i).Count; j++)
            {
                var TempPt = PtsSet.Branch(i)[j];
                PtList.Add(PtsSet.Branch(i)[j]);
                var RoTS = Transform.Rotation(Angle, Point3d.Origin);
                TempPt.Transform(RoTS);

                if(!XArr.Contains(Math.Round(TempPt.X,3)))
                    XArr.Add(Math.Round(TempPt.X,3));
                if(!YArr.Contains(Math.Round(TempPt.Y,3)))
                    YArr.Add(Math.Round(TempPt.Y, 3));
                CheckPtList.Add(new Point3d(
                    Math.Round(TempPt.X,3),
                    Math.Round(TempPt.Y,3),
                    0
                ));
                
            }
        }
        XArr.Sort();
        YArr.Sort();
        

        var NewTree = new DataTree<Point3d>();
        for(int i = 0; i < YArr.Count; i++)
        {
            var TempList = new List<Point3d>();
            for(int j = 0; j < XArr.Count;j++)
            {
                if(CheckPtList.Contains(new Point3d(XArr[j], YArr[i], 0)))
                {
                    var Index = Find(CheckPtList,new Point3d(XArr[j], YArr[i], 0));
                    TempList.Add(PtList[Index]);
                }
            }
            NewTree.AddRange(TempList, new GH_Path(i));
        }
        return NewTree;
    }
     public int Find(IEnumerable<Point3d> AEnum, Point3d item)
    {
        var AList = AEnum.ToList();
        for(int i = 0; i < AList.Count; i++)
        {
            if(AList[i] == item)
                return i;
        }
        return -1;
    }
}
# ---------- end c_script_5 ----------
pt_2 = Point(path_mapper)

# ---- group: SL_Block / 1
button = Button()

# ---- group: SL_Block / 2
button_2 = Button()

# ---- group: SL_Block
num = Number("10")
c_script_6 = CSharpScript(Defined=button_2, Size=num, Name="SLBlock_2", Colour=ColourSwatch(SwatchColor=RGB(161, 255, 153)))  # -> out, oSLBlock; inputs Defined: Boolean, Size: Double, Name: String, Colour: list of Color
# ---------- c_script_6: C# ----------
// Grasshopper Script Instance
#region Usings
using System;
using System.Linq;
using System.Collections;
using System.Collections.Generic;
using System.Drawing;
using System.Text.Json;

using Rhino;
using Rhino.Geometry;

using Grasshopper;
using Grasshopper.Kernel;
using Grasshopper.Kernel.Data;
using Grasshopper.Kernel.Types;
#endregion

public class Script_Instance : GH_ScriptInstance
{
    #region Notes
    /* 
      Members:
        RhinoDoc RhinoDocument
        GH_Document GrasshopperDocument
        IGH_Component Component
        int Iteration

      Methods (Virtual & overridable):
        Print(string text)
        Print(string format, params object[] args)
        Reflect(object obj)
        Reflect(object obj, string method_name)
    */
    #endregion

    private void RunScript(
	bool Defined,
	double Size,
	string Name,
	List<Color> Colour,
	ref object oSLBlock)
    {
        double Resize = Size / 8;
        // Write your logic here
        var SL = new SLBlock(Resize, Name, Colour);
        var Doc = RhinoDoc.ActiveDoc;
        if(Defined)
        {
            if ((ID = SLBlock.FindSLBlock(Name)) == -1)
            {
                ID = SL.SetBlock();
            }   
        }
        oSLBlock = ID;
    }
    private int ID = -1;

    public class SLBlock
    {
        private double Size {get;}
        private Color[] Colours {get;} = new Color[2];
        private string Name {get;}
        private int BlockID {get;}
        private static Brep[] SLBlockBrep(double Size)
        {
            var Blocks = new Brep[2];
            var OriginPoint = new Point3d(-Size * 2, 0, -Size*2);
            List<Point3d> Contour_1 = new List<Point3d>(){OriginPoint,
            OriginPoint + new Vector3d(Size * 3, 0, 0),
            OriginPoint + new Vector3d(Size * 3, 0, Size),
            OriginPoint + new Vector3d(Size, 0, Size),
            OriginPoint + new Vector3d(Size, 0, Size * 2),
            OriginPoint + new Vector3d(0, 0, Size * 2),
            OriginPoint
            };
            PolylineCurve Curve_1 = new PolylineCurve(Contour_1);
            List<Point3d> Contour_2 = new List<Point3d>(){
            OriginPoint + new Vector3d(Size * 2, 0, 0),
            OriginPoint + new Vector3d(Size * 3, 0, 0),
            OriginPoint + new Vector3d(Size * 3, 0, Size),
            OriginPoint + new Vector3d(Size * 4, 0, Size),
            OriginPoint + new Vector3d(Size * 4, 0, Size * 3),
            OriginPoint + new Vector3d(Size * 3, 0, Size * 3),
            OriginPoint + new Vector3d(Size * 3, 0, Size * 2),
            OriginPoint + new Vector3d(Size * 2, 0, Size * 2),
            OriginPoint + new Vector3d(Size * 2, 0, 0)
            };
            PolylineCurve Curve_2 = new PolylineCurve(Contour_2);
            var Extrude_1 = Extrusion.Create(Curve_1, Size, true).ToBrep();
            var Extrude_2 = Extrusion.Create(Curve_2, -Size, true).ToBrep();
            Brep SL_Block = Brep.CreateBooleanUnion(new List<Brep>() { Extrude_1, Extrude_2 }, 0.1)[0];
            SL_Block.MergeCoplanarFaces(0.1, 0.1);
            
            
            if(Size > 1)
            {

                List<int> edgeInt = new List<int>();
                List<double> Radius = new List<double>();
                for (int i = 0; i < SL_Block.Edges.Count; i++)
                {
                    edgeInt.Add(i);
                    Radius.Add(Size * 0.1);
                }
                SL_Block = Brep.CreateFilletEdges(SL_Block, edgeInt, Radius, Radius, BlendType.Chamfer , RailType.DistanceFromEdge, 0.1)[0];
                Curve[] OuterCurve = SL_Block.DuplicateNakedEdgeCurves(true, false);
                List<Brep> JoinBreps = new List<Brep>();
                foreach (Curve cur in Curve.JoinCurves(SL_Block.DuplicateNakedEdgeCurves(true, false), 0.1))
                {
                    var Segs = cur.DuplicateSegments();
                    var Cap_Srf = Brep.CreateEdgeSurface(Segs);
                    JoinBreps.Add(Cap_Srf);
                }
            
                JoinBreps.Add(SL_Block);
                SL_Block = Brep.JoinBreps(JoinBreps, 0.1)[0];
            }
                SL_Block.Rotate(Math.PI, Vector3d.ZAxis, Point3d.Origin);
                Blocks[0] = SL_Block.DuplicateBrep();
                SL_Block.Rotate(Math.PI, Vector3d.YAxis, Point3d.Origin);
                Blocks[1] = SL_Block.DuplicateBrep();
            return Blocks;
        }

        private static Dictionary<string, Transform> SLBlockTS(double Size = 5)
        {
            var Voca = new Dictionary<string, Transform>();
            string[] Labels = new string[]{"H", "A", "D", "S", "T", "Y"};
            double[] TranslationX = new double[] {
                Size * 2,
                Size,
                Size * 2,
                Size,
                Size,
                Size
            };
            double[] TranslationY = new double[] {
                0,
                -Size,
                0,
                Size,
                -Size,
                Size
            };
            double[] TranslationZ = new double[] {
                0,
                0,
                -Size,
                -Size,
                Size,
                -Size * 2
            };
            double[] RotateX = new double[]
            {
                0, -90, 0, 90, -90, 90
            };
            double[] RotateZ = new double[]
            {
                180, 0, 0, 180, 180, 0
            };
            for (int i = 0; i < 6; i++)
            {
                var MxTranslation = Transform.Translation(new Vector3d(TranslationX[i], TranslationY[i], TranslationZ[i]));
                var MxRotateX = Transform.Rotation(RotateX[i] * Math.PI / 180, Point3d.Origin);
                var MxRotateZ = Transform.Rotation(-RotateZ[i] * Math.PI / 180, Vector3d.XAxis, Point3d.Origin);
                Voca.Add(Labels[i], MxTranslation * MxRotateX * MxRotateZ);
            }
            return Voca;
        }

        public SLBlock(double Size, string Name) : this(Size, Name, new List<Color>{Color.Red, Color.Red})
        {

        }
        public SLBlock(double Size, string Name, List<Color> Cols)
        {
            this.Size = Size;
            this.Name = Name;
            if(Cols.Count > 1)
            {
            this.Colours[0] = Cols[0];
            this.Colours[1] = Cols[1];
            }
            else
            {
                this.Colours[0] = Cols[0];
                this.Colours[1] = Cols[0];
            }
        }
        public static int FindSLBlock(string Name)
        {
            var ID = -1;
            var Doc = RhinoDoc.ActiveDoc;
            try {ID = Doc.InstanceDefinitions.Find(Name).Index;}
            catch {ID = -1;}
            return ID;
        }
        private static int TryFindLayer()
        {
            var ID = -1;
            var Doc = RhinoDoc.ActiveDoc;
            try{ID = Doc.Layers.FindName("SLBlockLayer").Index;}
            catch{ID = -1;}
            return ID;
        }
        public int SetBlock()
        {
            var Doc = RhinoDoc.ActiveDoc;
            int LayerIndex = -1;
            if((LayerIndex = TryFindLayer()) == -1)
            {
                var NewLayer = new Rhino.DocObjects.Layer{
                    Name = "SLBlockLayer",Color = Color.Black
                };
                LayerIndex = Doc.Layers.Add(NewLayer);
            }
            var Att1 = new Rhino.DocObjects.ObjectAttributes
            {
                LayerIndex = LayerIndex, 
                ColorSource = Rhino.DocObjects.ObjectColorSource.ColorFromObject,
                ObjectColor=Colours[0]
            };
            var Att2 = new Rhino.DocObjects.ObjectAttributes
            {
                LayerIndex = LayerIndex, 
                ColorSource = Rhino.DocObjects.ObjectColorSource.ColorFromObject,
                ObjectColor=Colours[0]
            };
            var ID = Doc.InstanceDefinitions.Add(
                this.Name, "SLBlock_" + this.Name, 
                Point3d.Origin,  
                SLBlockBrep(this.Size), 
                new Rhino.DocObjects.ObjectAttributes[]{Att1, Att2}
            );

            var Voca = SLBlockTS(this.Size);
            var Instance = Doc.InstanceDefinitions.Find(this.Name);
            Instance.SetUserString("Name", this.Name);
            Instance.SetUserString("ID", "UNSET");
            Instance.SetUserString("TransformToken", "H,A,D,S,T,Y");
            foreach (var Kvp in Voca)
            {
                Instance.SetUserString(Kvp.Key, TransformToJson(Kvp.Value));
            }
            return ID;
        }
        public static string TransformToJson(Transform TS)
        => JsonSerializer.Serialize<Transform>(TS);
        
        public static Transform TransformFromJson(string Str)
        => JsonSerializer.Deserialize<Transform>(Str);
    }
}
# ---------- end c_script_6 ----------
# Define SL Block First
c_script_7 = CSharpScript(Defined=button, Size=num, Name="SLBlock_1", Colour=ColourSwatch(SwatchColor=RGB(194, 153, 255)))  # -> out, oSLBlock; inputs Defined: Boolean, Size: Double, Name: String, Colour: list of Color; same code as c_script_6
panel = Panel(c_script_7.oSLBlock)
c_script_8 = CSharpScript(Place=Button(), iSLBlock=c_script_6.oSLBlock)  # -> out, UserData, TS; inputs Place: Boolean, iSLBlock: Int32
# ---------- c_script_8: C# ----------
// Grasshopper Script Instance
#region Usings
using System;
using System.Linq;
using System.Collections;
using System.Collections.Generic;
using System.Drawing;
using System.Text.Json;

using Rhino;
using Rhino.Geometry;

using Grasshopper;
using Grasshopper.Kernel;
using Grasshopper.Kernel.Data;
using Grasshopper.Kernel.Types;
#endregion

public class Script_Instance : GH_ScriptInstance
{
    #region Notes
    /* 
      Members:
        RhinoDoc RhinoDocument
        GH_Document GrasshopperDocument
        IGH_Component Component
        int Iteration

      Methods (Virtual & overridable):
        Print(string text)
        Print(string format, params object[] args)
        Reflect(object obj)
        Reflect(object obj, string method_name)
    */
    #endregion

    private void RunScript(
	bool Place,
	int iSLBlock,
	ref object UserData,
	ref object TS)
    {
        // Write your logic here
        var Doc = RhinoDoc.ActiveDoc;
        var Instance = Doc.InstanceDefinitions.ToList()[iSLBlock];
        if(Place) Doc.Objects.AddInstanceObject(iSLBlock, Transform.Identity);
        var UserString = Instance.GetUserStrings();
        var Dic = new Dictionary<string, string>();
        foreach (string item in Instance.GetUserStrings().Keys)
        {
            Dic.Add(item, Instance.GetUserString(item));
        }
        TS = JsonSerializer.Deserialize<Transform>(Dic["H"]);
        UserData = Dic;
    }
}
# ---------- end c_script_8 ----------
panel_2 = Panel(c_script_8.UserData)
merge = Merge(Data1=c_script_7.oSLBlock, Data2=c_script_6.oSLBlock)

# ---- group: U
button_3 = Button()

# ---- group: StepByStep
button_4 = Button()

# ---- group: V
button_5 = Button()

# ----
panel_3 = Panel("Y")
panel_4 = Panel("""#Defined HR <HR>
#Defined AR <AR>
#Defined HB <HB>
#Defined AB <AB>
<HR> = H SLBlock_1
<AR> = A SLBlock_1
<HB> = H SLBlock_2
<AB> = A SLBlock_2""")

num_2 = Number("10")
vec = Vector(vrot)
vec_2 = Vector(X)
division_3 = Division(A=num_2, B="2")
division_4 = Division(A=num_2, B="4")
pt_3 = Point(c_script_4.V_0)
pt_4 = Point(c_script_4.U_0)
neg = Negative(Value=division_4)
Z_2 = UnitZ(Factor=division_4)
Z_3 = UnitZ(Factor=neg)
move = Move(Geometry=c_script_4.U_1, Motion=Z_3)  # -> Geometry, Transform
move_2 = Move(Geometry=pt_4, Motion=Z_2)  # -> Geometry, Transform
move_3 = Move(Geometry=c_script_4.V_1, Motion=Z_2)  # -> Geometry, Transform
move_4 = Move(Geometry=pt_3, Motion=Z_3)  # -> Geometry, Transform
pt_5 = Point(move_3.Geometry)
pt_6 = Point(move_4.Geometry)
amp = Amplitude(Vector=vec_2, Amplitude=division_3)
pt_7 = Point(move_2.Geometry)
pt_8 = Point(move.Geometry)
amp_2 = Amplitude(Vector=vec_2, Amplitude=division_3)
amp_3 = Amplitude(Vector=vec, Amplitude=division_3)
amp_4 = Amplitude(Vector=vec, Amplitude=division_3)
rev = Reverse(Vector=amp)
rev_2 = Reverse(Vector=amp_2)
rev_3 = Reverse(Vector=amp_3)
rev_4 = Reverse(Vector=amp_4)
move_5 = Move(Geometry=pt_5, Motion=amp_2)  # -> simplify(Geometry), Transform
move_6 = Move(Geometry=pt_6, Motion=amp)  # -> simplify(Geometry), Transform
move_7 = Move(Geometry=pt_5, Motion=rev_2)  # -> simplify(Geometry), Transform
move_8 = Move(Geometry=pt_6, Motion=rev)  # -> simplify(Geometry), Transform
move_9 = Move(Geometry=pt_7, Motion=amp_3)  # -> simplify(Geometry), Transform
move_10 = Move(Geometry=pt_8, Motion=amp_4)  # -> simplify(Geometry), Transform
move_11 = Move(Geometry=pt_7, Motion=rev_3)  # -> simplify(Geometry), Transform
move_12 = Move(Geometry=pt_8, Motion=rev_4)  # -> simplify(Geometry), Transform
Z_4 = UnitZ(Factor=1)

weave = Weave(Pattern=c_script_4.V_Pattern, Stream0=move_7.Geometry, Stream1=move_8.Geometry, NullGaps=False)
weave_2 = Weave(Pattern=c_script_4.V_Pattern, Stream0=move_5.Geometry, Stream1=move_6.Geometry, NullGaps=False)
weave_3 = Weave(Pattern=c_script_4.U_Pattern, Stream0=move_10.Geometry, Stream1=move_9.Geometry, NullGaps=False)
weave_4 = Weave(Pattern=c_script_4.U_Pattern, Stream0=move_12.Geometry, Stream1=move_11.Geometry, NullGaps=False)
weave_5 = Weave(Pattern=[0, 1], Stream0=weave, Stream1=weave_2, NullGaps=False)
weave_6 = Weave(Pattern=[0, 1], Stream0=weave_4, Stream1=weave_3, NullGaps=False)

cset = CreateSet(List=weave_6)  # -> Set, Map
cset_2 = CreateSet(List=weave_5)  # -> Set, Map
pline = PolyLine(Vertices=cset.Set, Closed=False)
pline_2 = PolyLine(Vertices=cset_2.Set, Closed=False)
c_script_9 = CSharpScript(StPath=pline, Sth1=vec, Stv2=Z_4, CellDim=division_3)  # -> out, simplify(CellResult); inputs StPath: Curve, Sth1: Vector3d, Stv2: Vector3d, CellDim: Double
# ---------- c_script_9: C# ----------
// Grasshopper Script Instance
#region Usings
using System;
using System.Linq;
using System.Collections;
using System.Collections.Generic;
using System.Drawing;
using System.Linq;

using Rhino;
using Rhino.Geometry;
using Rhino.Geometry.Intersect;

using Grasshopper;
using Grasshopper.Kernel;
using Grasshopper.Kernel.Data;
using Grasshopper.Kernel.Types;
#endregion

public class Script_Instance : GH_ScriptInstance
{
    #region Notes
    /* 
      Members:
        RhinoDoc RhinoDocument
        GH_Document GrasshopperDocument
        IGH_Component Component
        int Iteration

      Methods (Virtual & overridable):
        Print(string text)
        Print(string format, params object[] args)
        Reflect(object obj)
        Reflect(object obj, string method_name)
    */
    #endregion
    public double DIM {get; set;}
    private void RunScript(
	Curve StPath,
	Vector3d Sth1,
	Vector3d Stv2,
	double CellDim,
	ref object CellResult)
    {
        // Write your logic here
        DIM = CellDim;
        var Cell = ReorientedRec
        (
            StPath.PointAtStart, 
            RectangleGet(DIM, Stv2, Sth1)
        );
        var Cells = new List<Curve>{Cell.DuplicateCurve()};
        var ts = new List<double>();
        var tsStore = new DataTree<double>();
        double t = Intersection.CurveCurve(StPath, Cell, 0.2, 0.1).ToList()[0].ParameterA;
        int CC = 0;

        while(true)
        {
            if(ts.Contains(Math.Round(t,4))) break;
            else
            {
                var Tangent = StPath.TangentAt(t);
                ts.Add(Math.Round(t,4));
                Tangent *= CellDim;
                Cell.Translate(Tangent);
                Cells.Add(Cell.DuplicateCurve());
                var tsTemp = Intersection.CurveCurve(StPath, Cell, 0.1, 0.1).Select(x => x.ParameterA).ToList();
                tsStore.AddRange(tsTemp, new GH_Path(CC));
                t = tsTemp.Count == 1 ? tsTemp[0] : tsTemp.Last();
                
                CC++;
            }
            if(CC >= 1500) 
            {
                this.Component.AddRuntimeMessage(GH_RuntimeMessageLevel.Error, "Error for Endless Loop");
                break;
            }
        }
        CellResult = Cells;
    }
    
    public Curve ReorientedRec(Point3d Pt, Curve Rec)
    {
        var DuRec = Rec.DuplicateCurve();
        DuRec.Translate(new Vector3d(Pt));
        return DuRec;
    }
    public Curve RectangleGet(double DIM, Vector3d Vertical, Vector3d Horizonal)
        => new PolylineCurve(new Point3d[]{
            Point3d.Origin + Vertical * DIM / 2 + Horizonal * DIM / 2,
            Point3d.Origin + Vertical * DIM / 2 - Horizonal * DIM / 2,
            Point3d.Origin - Vertical * DIM / 2 - Horizonal * DIM / 2,
            Point3d.Origin - Vertical * DIM / 2 + Horizonal * DIM / 2,
            Point3d.Origin + Vertical * DIM / 2 + Horizonal * DIM / 2
        });  
    
}
# ---------- end c_script_9 ----------
c_script_10 = CSharpScript(StPath=pline_2, Sth1=vec_2, Stv2=Z_4, CellDim=division_3)  # -> out, simplify(CellResult); inputs StPath: Curve, Sth1: Vector3d, Stv2: Vector3d, CellDim: Double; same code as c_script_9

c_script_11 = CSharpScript(StPath=pline_2, Sth1=vec_2, Stv2=Z_4, CellDim=division_3)  # -> out, simplify(Sentence), TS; inputs StPath: Curve, Sth1: Vector3d, Stv2: Vector3d, CellDim: Double
# ---------- c_script_11: C# ----------
// Grasshopper Script Instance
#region Usings
using System;
using System.Linq;
using System.Collections;
using System.Collections.Generic;
using System.Drawing;
using System.Linq;

using Rhino;
using Rhino.Geometry;
using Rhino.Geometry.Intersect;

using Grasshopper;
using Grasshopper.Kernel;
using Grasshopper.Kernel.Data;
using Grasshopper.Kernel.Types;
#endregion

public class Script_Instance : GH_ScriptInstance
{
    #region Notes
    /* 
      Members:
        RhinoDoc RhinoDocument
        GH_Document GrasshopperDocument
        IGH_Component Component
        int Iteration

      Methods (Virtual & overridable):
        Print(string text)
        Print(string format, params object[] args)
        Reflect(object obj)
        Reflect(object obj, string method_name)
    */
    #endregion
    public double DIM {get; set;}
    private void RunScript(
	Curve StPath,
	Vector3d Sth1,
	Vector3d Stv2,
	double CellDim,
	ref object Sentence,
	ref object TS)
    {
        var PL = new Plane(StPath.PointAtStart, Stv2, Sth1);
        var Cell = ReorientedRec(StPath.PointAtStart, RectangleGet(CellDim, Stv2, Sth1));
        var AdjustPt = StPath.PointAtStart - Sth1 * CellDim / 4;
        TS = Transform.PlaneToPlane(Plane.WorldXY, new Plane(AdjustPt, Stv2, -Sth1));
        var StartSentence = "#S";
        var ts = new List<double>();
        double t = Intersection.CurveCurve(StPath, Cell, 0.2, 0.1).ToList()[0].ParameterA;
        int CC = 0;
        while(true)
        {
            if(ts.Contains(Math.Round(t,4))) break;
            else
            {
                var Tangent = StPath.TangentAt(t);
                ts.Add(Math.Round(t,4));
                Tangent *= CellDim;
                Cell.Translate(Tangent);
                var tsTemp = Intersection.CurveCurve(StPath, Cell, 0.1,0.1).Select(x => x.ParameterA).ToList();
                t = tsTemp.Count == 1 ? tsTemp[0] : tsTemp.Last();
                if(tsTemp.Count > 1)
                {
                var TestVector = StPath.TangentAt(t);
                Tangent.Unitize();
                var angle = Vector3d.VectorAngle(Tangent, TestVector, PL);
                if(angle == 0)
                    StartSentence += "S";
                else if(Math.Round(angle,3) == Math.Round(Math.PI / 2, 3))
                    StartSentence += "R";
                else if(Math.Round(angle,3) == Math.Round(Math.PI / 2 * 3,3))
                    StartSentence += "L";
                else
                    StartSentence += "E";
                }
                else
                {
                    StartSentence += "S#";
                }
            }


            CC++;
            if(CC >= 1500) 
            {
                this.Component.AddRuntimeMessage(GH_RuntimeMessageLevel.Error, "Error for Endless Loop");
                break;
            }
        }

        Sentence = StartSentence;
    }   
    
    public Curve ReorientedRec(Point3d Pt, Curve Rec)
    {
        var DuRec = Rec.DuplicateCurve();
        DuRec.Translate(new Vector3d(Pt));
        return DuRec;
    }
    public Curve RectangleGet(double DIM, Vector3d Vertical, Vector3d Horizonal)
        => new PolylineCurve(new Point3d[]{
            Point3d.Origin + Vertical * DIM / 2 + Horizonal * DIM / 2,
            Point3d.Origin + Vertical * DIM / 2 - Horizonal * DIM / 2,
            Point3d.Origin - Vertical * DIM / 2 - Horizonal * DIM / 2,
            Point3d.Origin - Vertical * DIM / 2 + Horizonal * DIM / 2,
            Point3d.Origin + Vertical * DIM / 2 + Horizonal * DIM / 2
        });  
    
}
# ---------- end c_script_11 ----------
c_script_12 = CSharpScript(Sentence=c_script_11.Sentence)  # -> out, Semantic; inputs Sentence: String
# ---------- c_script_12: C# ----------
// Grasshopper Script Instance
#region Usings
using System;
using System.Linq;
using System.Collections;
using System.Collections.Generic;
using System.Drawing;
using System.Text;

using Rhino;
using Rhino.Geometry;

using Grasshopper;
using Grasshopper.Kernel;
using Grasshopper.Kernel.Data;
using Grasshopper.Kernel.Types;
#endregion

public class Script_Instance : GH_ScriptInstance
{
    #region Notes
    /* 
      Members:
        RhinoDoc RhinoDocument
        GH_Document GrasshopperDocument
        IGH_Component Component
        int Iteration

      Methods (Virtual & overridable):
        Print(string text)
        Print(string format, params object[] args)
        Reflect(object obj)
        Reflect(object obj, string method_name)
    */
    #endregion

    private void RunScript(string Sentence, ref object Semantic)
    {
        Parser parser = new Parser(Sentence);
    if (parser.Parse())
    {
        //Semantic = parser.GetOutput();
        Semantic = parser.SortLanguage();
    }
    else
    {
        Semantic = parser.GetOutput() + ": Failed";
    }

    }
}

public enum TokenType {Hash, S, R, L, EOF}

public class Token
{
    public TokenType Type {get;}
    public Token(TokenType type) {Type = type;}
}
// Grammar Rule for parser
        /*
        <Start> = #SS
        <DOWN> = L R | L <DOWNH> R
        <DOWNH> = S <DOWNH> | empty
        <UP> = R L | R <UPN> L
        <UPN> = S <UPN> | empty
        <ADD> = <DOWN> S | <UP> S
        <R> = SS#
        */
public class Parser
{
    private List<Token> Tokens;
    private int position = 0;
    private StringBuilder output = new StringBuilder();
    private StringBuilder ErrorMessage = new StringBuilder();

    public Parser(string input)
    {
        Tokens = Tokenise(input);
    }

    private List<Token> Tokenise(string input)
    {
        var tokens = new List<Token>();
        foreach (var c in input)
        {
            switch (c)
            {
                case '#': tokens.Add(new Token(TokenType.Hash)); break;
                case 'S': tokens.Add(new Token(TokenType.S)); break;
                case 'R': tokens.Add(new Token(TokenType.R)); break;
                case 'L': tokens.Add(new Token(TokenType.L)); break;
            }
        }
        tokens.Add(new Token(TokenType.EOF));
        return tokens;
    }

    private Token CurrentToken => Tokens[position];
    private void Advance() => position++;
    private bool Match(TokenType type)
    {
        if (CurrentToken.Type == type)
        {
            Advance();
            return true;
        }
        else
            return false;
    }

    public bool Parse()
    {
        bool result = ParseAxiom() && Match(TokenType.EOF);
        if(!result)
            output.Append(this.ErrorMessage.ToString());
        return result;
    }

    public bool ParseAxiom()
    {
        if (ParseStart())
        {
            if (ParseMid())
            {
                // <END> is epsilon; no action needed
                output.Append("h h h a"); // From <END>
                ErrorMessage.Clear();
                return true;
            }
        }

        ErrorMessage.Append(" #Axiom ");
        return false;

    }

    private bool ParseStart()
    {
        if (Match(TokenType.Hash) && Match(TokenType.S) && Match(TokenType.S))
        {
            output.Append("a h h h ");
            ErrorMessage.Clear();
            return true;
        }
        ErrorMessage.Append(" #Start ");
        return false;
    }

    private bool ParseMid()
    {
        int savedPosition = position;

        if (ParseUP())
        {
            ErrorMessage.Clear();
            return true;
        }
        position = savedPosition;
        if (ParseDOWN())
        {
            ErrorMessage.Clear();
            return true;
        }
        position = savedPosition;
        if (ParseS())
        {
            ErrorMessage.Clear();
            return true;
        }
        position = savedPosition;
        if (ParseR())
        {
            ErrorMessage.Clear();
            return true;
        }
        ErrorMessage.Append(" #MID ");
        return false;
    }

    private bool ParseUP()
    {
        if (Match(TokenType.R))
        {
            output.Append("h a h ");
            if (ParseUPH())
            {
                ErrorMessage.Clear();
                output.Append("a ");
                return true;
            }
        }
        ErrorMessage.Append(" #UP ");
        return false;
    }

    private bool ParseUPH()
    {
        var savePosition = position;
        if(Match(TokenType.S))
        {
            output.Append("h h ");
            if(ParseUPH())
            {
                output.Append("h h ");
                return true;
            }
        }
        position = savePosition;
        if (Match(TokenType.L))
        {
            output.Append("a ");
            if (ParseADD())
            {
                output.Append("h a h ");
                ErrorMessage.Clear();
                return true;
            }
        }

        ErrorMessage.Append(" #UPH ");
        return false;
    }

    private bool ParseDOWN()
    {
        if (Match(TokenType.L))
        {
            output.Append("a ");
            if (ParseDOWNH())
            {
                output.Append("h a h ");
                ErrorMessage.Clear();
                return true;
            }
        }
        ErrorMessage.Append(" #DOWN ");
        return false;
    }

    private bool ParseDOWNH()
    {
        var savePosition = position;
        if(Match(TokenType.S))
        {
            output.Append("h h ");
            if(ParseDOWNH())
            {
                output.Append("h h ");
                return true;
            }
        }
        position = savePosition;

        if (Match(TokenType.R))
        {
            output.Append("h a h ");
            if (ParseADD())
            {
                output.Append("a ");
                ErrorMessage.Clear();
                return true;
            }
        }
        ErrorMessage.Append(" #DOWNH ");
        return false;
    }

    private bool ParseS()
    {
        int savePosition = position;
        if(Match(TokenType.S))
        {
            output.Append("h h ");
            
            if(ParseADD())
            {
                output.Append("h h ");
                ErrorMessage.Clear();
                return true;
            }
        }
        position = savePosition;
        if (Match(TokenType.S) && Match(TokenType.S))
        {
            output.Append("h h h h ");
            if(ParseS())
            {
                output.Append("h h h h ");
                ErrorMessage.Clear();
                return true;
            }
        }

        ErrorMessage.Append(" #S ");
        return false;
    }

    private bool ParseR()
    {
        if (Match(TokenType.S) && Match(TokenType.S) && Match(TokenType.Hash))
        {
            output.Append("h h h a a h h h ");
            ErrorMessage.Clear();
            return true;
        }
        ErrorMessage.Append(" #R ");
        return false;
    }

    private bool ParseADD()
    {
        int savedPosition = position;

        if (ParseR())
        {
            ErrorMessage.Clear();
            return true;
        }
        position = savedPosition;
        if (Match(TokenType.S))
        {
            output.Append("h h ");
            if (ParseMid())
            {
                output.Append("h h ");
                ErrorMessage.Clear();
                return true;
            }
        }
        ErrorMessage.Append(" #ADD ");
        return false;
    }

    private bool ParseEnd()
    {
        // <END> is epsilon; no action needed
        ErrorMessage.Clear();
        return true;
    }
    public string SortLanguage()
    {
        string[] outStr = output.ToString().Split(' ');
        string FinalString = "";
        int DupCount = 1;
        for(int i = 0; i < outStr.Length - 1; i++)
        {
                if(outStr[i] == outStr[i+1])
                    DupCount++;
                else
                {
                    if(DupCount == 1)
                        FinalString += outStr[i] + " ";
                    else
                    {
                        FinalString += DupCount.ToString() + " " + outStr[i] + " ";
                        DupCount = 1;
                    }
                }
        }
        FinalString += outStr.Last();
        return FinalString;
    }
    public string GetOutput() => output.ToString().Trim();
}
# ---------- end c_script_12 ----------
c_script_13 = CSharpScript(StPath=pline, Sth1=vec, Stv2=Z_4, CellDim=division_3)  # -> out, simplify(Sentence), TS; inputs StPath: Curve, Sth1: Vector3d, Stv2: Vector3d, CellDim: Double
# ---------- c_script_13: C# ----------
// Grasshopper Script Instance
#region Usings
using System;
using System.Linq;
using System.Collections;
using System.Collections.Generic;
using System.Drawing;
using System.Linq;

using Rhino;
using Rhino.Geometry;
using Rhino.Geometry.Intersect;

using Grasshopper;
using Grasshopper.Kernel;
using Grasshopper.Kernel.Data;
using Grasshopper.Kernel.Types;
#endregion

public class Script_Instance : GH_ScriptInstance
{
    #region Notes
    /* 
      Members:
        RhinoDoc RhinoDocument
        GH_Document GrasshopperDocument
        IGH_Component Component
        int Iteration

      Methods (Virtual & overridable):
        Print(string text)
        Print(string format, params object[] args)
        Reflect(object obj)
        Reflect(object obj, string method_name)
    */
    #endregion
    public double DIM {get; set;}
    private void RunScript(
	Curve StPath,
	Vector3d Sth1,
	Vector3d Stv2,
	double CellDim,
	ref object Sentence,
	ref object TS)
    {
        var PL = new Plane(StPath.PointAtStart, Stv2, Sth1);
        var Cell = ReorientedRec(StPath.PointAtStart, RectangleGet(CellDim, Stv2, Sth1));
        var AdjustPt = StPath.PointAtStart - Sth1 * CellDim / 4;
        TS = Transform.PlaneToPlane(Plane.WorldXY, new Plane(AdjustPt, Stv2, -Sth1));
        var StartSentence = "#S";
        var ts = new List<double>();
        double t = Intersection.CurveCurve(StPath, Cell, 0.2, 0.1).ToList()[0].ParameterA;
        int CC = 0;
        while(true)
        {
            if(ts.Contains(Math.Round(t,4))) break;
            else
            {
                var Tangent = StPath.TangentAt(t);
                ts.Add(Math.Round(t,4));
                Tangent *= CellDim;
                Cell.Translate(Tangent);
                var tsTemp = Intersection.CurveCurve(StPath, Cell, 0.1,0.1).Select(x => x.ParameterA).ToList();
                t = tsTemp.Count == 1 ? tsTemp[0] : tsTemp.Last();
                if(tsTemp.Count > 1)
                {
                var TestVector = StPath.TangentAt(t);
                Tangent.Unitize();
                var angle = Vector3d.VectorAngle(Tangent, TestVector, PL);
                if(angle == 0)
                    StartSentence += "S";
                else if(Math.Round(angle,3) == Math.Round(Math.PI / 2, 3))
                    StartSentence += "R";
                else if(Math.Round(angle,3) == Math.Round(Math.PI / 2 * 3,3))
                    StartSentence += "L";
                else
                    StartSentence += "E";
                }
                else
                {
                    StartSentence += "S#";
                }
            }


            CC++;
            if(CC >= 1500) 
            {
                this.Component.AddRuntimeMessage(GH_RuntimeMessageLevel.Error, "Error for Endless Loop");
                break;
            }
        }

        var tokenStack = "";
        var InitialLanguage = "";
        Sentence = StartSentence;
    }   
    
    public Curve ReorientedRec(Point3d Pt, Curve Rec)
    {
        var DuRec = Rec.DuplicateCurve();
        DuRec.Translate(new Vector3d(Pt));
        return DuRec;
    }
    public Curve RectangleGet(double DIM, Vector3d Vertical, Vector3d Horizonal)
        => new PolylineCurve(new Point3d[]{
            Point3d.Origin + Vertical * DIM / 2 + Horizonal * DIM / 2,
            Point3d.Origin + Vertical * DIM / 2 - Horizonal * DIM / 2,
            Point3d.Origin - Vertical * DIM / 2 - Horizonal * DIM / 2,
            Point3d.Origin - Vertical * DIM / 2 + Horizonal * DIM / 2,
            Point3d.Origin + Vertical * DIM / 2 + Horizonal * DIM / 2
        });  
    
}
# ---------- end c_script_13 ----------
rep = ReplaceText(Text=c_script_12.Semantic, Find="a", Replace="AR", RecursiveReplace=False)

division_5 = Division(A="10", B=4)
amp_5 = Amplitude(Vector=vec, Amplitude=division_5)
crv = Curve(c_script_10.CellResult)
amp_6 = Amplitude(Vector=vec_2, Amplitude=division_5)
crv_2 = Curve(c_script_9.CellResult)
rev_5 = Reverse(Vector=amp_5)
rev_6 = Reverse(Vector=amp_6)
extr = Extrude(Base=crv_2, Direction=rev_6)  # -> simplify(Extrusion)
extr_2 = Extrude(Base=crv_2, Direction=amp_6)  # -> simplify(Extrusion)
extr_3 = Extrude(Base=crv, Direction=amp_5)  # -> simplify(Extrusion)
extr_4 = Extrude(Base=crv, Direction=rev_5)  # -> simplify(Extrusion)
merge_2 = Merge(Data1=graft(extr_2), Data2=graft(extr))
merge_3 = Merge(Data1=graft(extr_3), Data2=graft(extr_4))
join = BrepJoin(Breps=merge_2)  # -> simplify(Breps), Closed
join_2 = BrepJoin(Breps=merge_3)  # -> simplify(Breps), Closed
cap = CapHoles(Brep=join.Breps)
cap_2 = CapHoles(Brep=join_2.Breps)
cap_3 = CapHoles(Brep=cap)
cap_4 = CapHoles(Brep=cap_2)
preview = CustomPreview(Geometry=cap_4, Material=ColourSwatch(SwatchColor=RGBA(41, 46, 18, 154)))
preview_2 = CustomPreview(Geometry=cap_3, Material=ColourSwatch(SwatchColor=RGBA(99, 224, 255, 154)))

c_script_14 = CSharpScript(Sentence=c_script_13.Sentence)  # -> out, Semantic; inputs Sentence: String; same code as c_script_12
rep_2 = ReplaceText(Text=rep, Find="h", Replace="HR", RecursiveReplace=False)
panel_5 = Panel(rep_2)
rep_3 = ReplaceText(Text=c_script_14.Semantic, Find="a", Replace="AB", RecursiveReplace=False)
rep_4 = ReplaceText(Text=rep_3, Find="h", Replace="HB", RecursiveReplace=False)
tstat = TreeStatistics(Tree=panel_5)  # -> Paths, Length, Count
concat = Concatenate(FragmentA="<Axiom> = ", FragmentB=panel_5)
stack = StackData(Data=graft(panel_4), Stack=tstat.Count)
tstat_2 = TreeStatistics(Tree=rep_4)  # -> Paths, Length, Count
flip = FlipMatrix(Data=stack)  # -> simplify(Data)
concat_2 = Concatenate(FragmentA="<Axiom> = ", FragmentB=rep_4)
stack_2 = StackData(Data=graft(panel_4), Stack=tstat_2.Count)
branch = TreeBranch(Tree=c_script_11.TS, Path="0", MaintainPaths=True)
branch_2 = TreeBranch(Tree=c_script_10.CellResult, Path="0", MaintainPaths=True)
flip_2 = FlipMatrix(Data=stack_2)  # -> simplify(Data)
merge_4 = Merge(Data1=flip, Data2=concat)
branch_3 = TreeBranch(Tree=merge_4, Path="0", MaintainPaths=True)
merge_5 = Merge(Data1=flip_2, Data2=concat_2)

# ---- group: StepByStep
c_script_15 = CSharpScript(iRules=branch_3, Axiom="<Axiom>", Bake=button_4, Blocks=merge, RePosition=branch)  # -> out, cmd, Terminal, Nonterminal; inputs iRules: list of String, Axiom: String, Bake: Boolean, Blocks: list of Int32, RePosition: Transform
# ---------- c_script_15: C# ----------
// Grasshopper Script Instance
#region Usings
using System;
using System.Linq;
using System.Collections;
using System.Collections.Generic;
using System.Drawing;
using System.Text.Json;
using System.Threading;

using Rhino;
using Rhino.Geometry;
using Rhino.DocObjects;

using Grasshopper;
using Grasshopper.Kernel;
using Grasshopper.Kernel.Data;
using Grasshopper.Kernel.Types;
#endregion

public class Script_Instance : GH_ScriptInstance
{
    #region Notes
    /* 
      Members:
        RhinoDoc RhinoDocument
        GH_Document GrasshopperDocument
        IGH_Component Component
        int Iteration

      Methods (Virtual & overridable):
        Print(string text)
        Print(string format, params object[] args)
        Reflect(object obj)
        Reflect(object obj, string method_name)
    */
    #endregion
    
    private void RunScript(
	List<string> iRules,
	string Axiom,
	bool Bake,
	List<int> Blocks,
	Transform RePosition,
	ref object cmd,
	ref object Terminal,
	ref object Nonterminal)
    {
        // Write your logic here
        var Commands = new CommandCodes(Blocks, iRules);
        Terminal = Commands.Terminals;
        Nonterminal = Commands.Nonterminals;
        
        if(Bake)
        {
            done = false;
            IterationCount = 0;
            Actions = new List<(string,CommandCodes.Action)>();
            GrasshopperDocument.ScheduleSolution(1, ScheduleSolutionCallback);
            Commands.ComputeStepbyStep(Axiom,ref Actions);
            StepByStepTS = RePosition;
        }
        else
        {
            if(!done && Actions.Count > 0)
            {
                done = Commands.BakeStepByStep(Actions, ref IterationCount, ref StepByStepTS);
                GrasshopperDocument.ScheduleSolution(1, ScheduleSolutionCallback);
            }
        }
        cmd = Commands.cmd;
    }
    Transform StepByStepTS = Transform.Identity;
    bool done = false;
    List<(string,CommandCodes.Action)> Actions = new List<(string,CommandCodes.Action)>();
    public void ScheduleSolutionCallback(GH_Document doc)
    {
        this.Component.ExpireSolution(false);
    }
    int IterationCount = 0;
}
//There is not stack inside
public class CommandCodes
{
    private List<string> Commands {get;}
    private List<int> InstanceID {get;}
    public delegate bool Action(ref Transform TS);
    public Dictionary<string, Action> Terminals {get; private set;}
    public List<(string, string)> Nonterminals {get; private set;}
    public string cmd {get; private set;} = "";
    public CommandCodes(IEnumerable<int> InstanceID, IEnumerable<string> Commands)
    {
        this.InstanceID = InstanceID.ToList();
        this.Commands = Commands.ToList();
        Configure();
    }
    public static string CleanString(string Str)
    {
        while(Str[0] == ' ')
        {
            Str = Str.Remove(0,1);
        }
        while(Str.Last() == ' ')
        {
            Str = Str.Remove(Str.Length-1);
        }
        return Str;
    }
    private bool GetTerminalToken(List<InstanceDefinition> Defs)
    {
        this.Terminals = new Dictionary<string, Action>();
        var AddTS = new List<string>();
        foreach (var Def in Defs)
        {
            var Tokens = Def.GetUserString("TransformToken").Split(',').ToList();
            if (Tokens.Count != 0)
        {
            foreach (var Token in Tokens)
            {
                var TSstring = Def.GetUserString(Token);
                
                if (TSstring == null) continue; // Null check for TSstring

                if (Terminals.ContainsKey(Token) && !AddTS.Contains(TSstring))
                {
                    cmd += "Duplicate token with different TSstring";
                    return false; // Duplicate token with different TSstring
                }
                else if (!Terminals.ContainsKey(Token))
                {
                    try
                    {
                        var TS = JsonSerializer.Deserialize<Transform>(TSstring);
                        
                        this.Terminals.Add(
                            Token,
                            (ref Transform x) =>
                            {
                                x = x * TS;
                                return true;
                            }
                        );
                        AddTS.Add(TSstring);
                    }
                    catch (JsonException ex)
                    {
                        cmd += $"Failed to deserialize Transform for token '{Token}': {ex.Message}";
                        return false; // Handle deserialization error
                    }
                }
            }
        }
            var NameToken = Def.GetUserString("Name");
            if (NameToken != null && !Terminals.ContainsKey(NameToken))
            {
                this.Terminals.Add(
                    NameToken,
                    (ref Transform x) =>
                    {
                        var ID = RhinoDoc.ActiveDoc.InstanceDefinitions.Find(NameToken);
                        if (ID != null)
                        {
                            RhinoDoc.ActiveDoc.Objects.AddInstanceObject(ID.Index, x);
                            return true;
                        }
                        return false; // Return false if the ID is not found
                    }
                );
            }
        }
        return true;
    }
    private bool GetNonterminalToken()
    {
        Nonterminals = new List<(string, string)>();
        for(int i = 0; i < this.Commands.Count; i++)
        {
            string Code = this.Commands[i];
            if(Code.Contains("//") || Code.Contains("#")) continue;
            if(Code.Contains("="))
            {
                string Head = CleanString(Code.Split('=')[0]);
                if(Code.Split('=')[1].Contains("="))
                {
                    cmd += "two or more = ";
                    return false;
                }
                if(Code.Contains("|"))
                {
                    string[] Bodies = Code.Split('=')[1].Split('|');
                    foreach (var body in Bodies)
                    {
                        this.Nonterminals.Add((Head, CleanString(body)));
                    }
                }
                else
                {
                    this.Nonterminals.Add((Head, CleanString(Code.Split('=')[1])));
                }
            }
        }
        if(Nonterminals.Count == 0)
        {
            cmd += "No nonterminals are set";
             return false;
        }
        return true;
    }
    private bool RunDefined()
    {
        foreach (var Code in Commands)
        {
            if(Code.Contains("#Defined"))
            {
                var SplitsElement = Code.Split(' ');
                if(SplitsElement.Length != 3)
                {
                    cmd += Code + " has error";
                    return false;
                }
                var NewNonterminals = new List<(string, string)>();
                for(int i = 0; i < this.Nonterminals.Count;i++)
                {
                    var Content = this.Nonterminals[i].Item2;
                    if(Content.Contains(SplitsElement[1]));
                        Content = Content.Replace(SplitsElement[1], SplitsElement[2]);
                    NewNonterminals.Add((this.Nonterminals[i].Item1, Content));
                }           
                this.Nonterminals = NewNonterminals;
            }
        }
        return true;
    }
    private bool ReConfigureNonterminalContent()
    {
        var TempList = new List<(string,string)>();
        foreach (var Code in this.Nonterminals)
        {
            var Content = Code.Item2;
            var Tokens = Content.Split(' ');
            var NewList = new List<string>();
            for(int k = 0; k <Tokens.Length; k++)
            {
                var Token = Tokens[k];
                if( int.TryParse(Token, out var N))
                {
                    if(N > 0)
                    {
                        k++;
                        Token = Tokens[k];
                        for(int i = 0; i < N;i++)
                            NewList.Add(Token);
                    }
                }
                else
                    NewList.Add(Token);
            }
            Content = string.Join(" ", NewList);
            TempList.Add((Code.Item1, Content));
        }
        this.Nonterminals = TempList;
        return true;
    }
    private bool Configure()
    {
        var Doc = Rhino.RhinoDoc.ActiveDoc;
        var InstanceObjects = new List<InstanceDefinition>();
        for(int i = 0; i < Doc.InstanceDefinitions.Count ; i++)
        {
            if(InstanceID.Contains(i))
                InstanceObjects.Add(Doc.InstanceDefinitions[i]);
        }
        if(!GetTerminalToken(InstanceObjects))
        {
            cmd += "Terminal failed";
            return false;
        }
        if(!GetNonterminalToken())
        {
            cmd += "Nonterminal failed";
            return false;
        }
        if(!RunDefined()) 
        {
            cmd += "Defined Error";
            return false;
        }
        ReConfigureNonterminalContent();

        cmd += "Configure finished\n==================================\n";
        return true;
    }
    private string RandomPick(IEnumerable<string> Strs)
    {
        var Rand = new Random(System.DateTime.Today.Millisecond);
        return Strs.ToList()[Rand.Next(Strs.ToList().Count)-1];
    }
    private string Space = " ";
    private bool Recurvsive(string Axiom, ref Transform Position)
    {
        var Contents = this.Nonterminals.Where(x => x.Item1 == Axiom).Select(x => x.Item2).ToList();
        if(Contents.Count == 0)
        {
            cmd += $"Cannot find {Axiom}";
            return false;
        }
        var CurrentContent = Contents.Count > 1 ? RandomPick(Contents) : Contents[0];

        var AxiomTokens = CurrentContent.Split(' ');
        var NonterminalsHeads = this.Nonterminals.Select(x => x.Item1 ).ToList();
        cmd += Space + $"{Axiom} : \n";
        foreach(var Token in AxiomTokens)
        {
            if(NonterminalsHeads.Contains(Token))
            {
                Space += " ";
                Recurvsive(Token, ref Position);
                Space = Space.Remove(Space.Length - 1);
            }
            else if(this.Terminals.ContainsKey(Token))
            {
                Space += "   ";
                cmd += Space + $"{Token}\n";
                var ActionResult = Terminals[Token](ref Position);
                Space = Space.Remove(Space.Length - 3);
            }
            
        }
        return true;
    }
    public bool Compute(string Axiom, Transform StartPosition = new Transform())
    {
        Transform InitialTransform = Transform.Identity;
        if(!(StartPosition == new Transform()))
            InitialTransform = StartPosition;

        var Contents = this.Nonterminals.Where(x => x.Item1 == Axiom).Select(x => x.Item2).ToList();
        if(Contents.Count == 0)
        {
            cmd += $"Cannot find {Axiom}";
            return false;
        }
        var CurrentContent = Contents.Count > 1 ? RandomPick(Contents) : Contents[0];

        var AxiomTokens = CurrentContent.Split(' ');
        var NonterminalsHeads = this.Nonterminals.Select(x => x.Item1 ).ToList();
        cmd += Space + $"{Axiom} : \n";
        foreach(var Token in AxiomTokens)
        {
            if(NonterminalsHeads.Contains(Token))
            {
                Space += " ";
                Recurvsive(Token, ref InitialTransform);
                Space = Space.Remove(Space.Length - 1);
            }
            else if(this.Terminals.ContainsKey(Token))
            {
                Space += "   ";
                cmd += Space + $"{Token}\n";
                var ActionResult = Terminals[Token](ref InitialTransform);
                Space = Space.Remove(Space.Length - 3);
            }      
        }
        return true;
    }
    private bool RecurvsiveStepbyStep(string Axiom, ref List<(string,Action)> Actions)
    {
        var Contents = this.Nonterminals.Where(x => x.Item1 == Axiom).Select(x => x.Item2).ToList();
        if(Contents.Count == 0)
        {
            cmd += $"Cannot find {Axiom}";
            return false;
        }
        var CurrentContent = Contents.Count > 1 ? RandomPick(Contents) : Contents[0];

        var AxiomTokens = CurrentContent.Split(' ');
        var NonterminalsHeads = this.Nonterminals.Select(x => x.Item1 ).ToList();
        cmd += Space + $"{Axiom} : \n";
        foreach(var Token in AxiomTokens)
        {
            if(NonterminalsHeads.Contains(Token))
            {
                Space += " ";
                RecurvsiveStepbyStep(Token, ref Actions);
                Space = Space.Remove(Space.Length - 1);
            }
            else if(this.Terminals.ContainsKey(Token))
            {
                Space += "   ";
                cmd += Space + $"{Token}\n";
                Actions.Add((Token,Terminals[Token]));
                Space = Space.Remove(Space.Length - 3);
            }
            
        }
        return true;
    }

    public bool ComputeStepbyStep(string Axiom, ref List<(string,Action)> Actions)
    {
        Actions = new List<(string,Action)>();
        var Contents = this.Nonterminals.Where(x => x.Item1 == Axiom).Select(x => x.Item2).ToList();
        if(Contents.Count == 0)
        {
            cmd += $"Cannot find {Axiom}";
            return false;
        }
        var CurrentContent = Contents.Count > 1 ? RandomPick(Contents) : Contents[0];

        var AxiomTokens = CurrentContent.Split(' ');
        var NonterminalsHeads = this.Nonterminals.Select(x => x.Item1 ).ToList();
        cmd += Space + $"{Axiom} : \n";
        foreach(var Token in AxiomTokens)
        {
            if(NonterminalsHeads.Contains(Token))
            {
                Space += " ";
                RecurvsiveStepbyStep(Token, ref Actions);
                Space = Space.Remove(Space.Length - 1);
            }
            else if(this.Terminals.ContainsKey(Token))
            {
                Space += "   ";
                cmd += Space + $"{Token}\n";
                Actions.Add((Token,Terminals[Token]));
                Space = Space.Remove(Space.Length - 3);
            }      
        }
        return true;
    }
    public bool BakeStepByStep(List<(string,Action)> Actions, ref int Iteration, ref Transform TS)
    {
        if(Iteration >= Actions.Count)
            return true; //Done

        var CallAction = Actions[Iteration];
        var Result = CallAction.Item2(ref TS);
        Iteration++;
        return !Result;
    }
}
# ---------- end c_script_15 ----------

# ----
c_script_16 = CSharpScript(iRules=merge_5, Axiom="<Axiom>", Bake=button_5, Blocks=merge, RePosition=c_script_13.TS)  # -> out, cmd, Terminal, Nonterminal; inputs iRules: list of String, Axiom: String, Bake: Boolean, Blocks: list of Int32, RePosition: Transform
# ---------- c_script_16: C# ----------
// Grasshopper Script Instance
#region Usings
using System;
using System.Linq;
using System.Collections;
using System.Collections.Generic;
using System.Drawing;
using System.Text.Json;

using Rhino;
using Rhino.Geometry;
using Rhino.DocObjects;

using Grasshopper;
using Grasshopper.Kernel;
using Grasshopper.Kernel.Data;
using Grasshopper.Kernel.Types;
#endregion

public class Script_Instance : GH_ScriptInstance
{
    #region Notes
    /* 
      Members:
        RhinoDoc RhinoDocument
        GH_Document GrasshopperDocument
        IGH_Component Component
        int Iteration

      Methods (Virtual & overridable):
        Print(string text)
        Print(string format, params object[] args)
        Reflect(object obj)
        Reflect(object obj, string method_name)
    */
    #endregion

    private void RunScript(
	List<string> iRules,
	string Axiom,
	bool Bake,
	List<int> Blocks,
	Transform RePosition,
	ref object cmd,
	ref object Terminal,
	ref object Nonterminal)
    {
        // Write your logic here
        var Commands = new CommandCodes(Blocks, iRules);
        Terminal = Commands.Terminals;
        Nonterminal = Commands.Nonterminals;
        if(Bake)
            Commands.Compute(Axiom, RePosition);
        cmd = Commands.cmd;
    }
}
//There is not stack inside
public class CommandCodes
{
    private List<string> Commands {get;}
    private List<int> InstanceID {get;}
    public delegate bool Action(ref Transform TS);
    public Dictionary<string, Action> Terminals {get; private set;}
    public List<(string, string)> Nonterminals {get; private set;}
    public string cmd {get; private set;} = "";
    public CommandCodes(IEnumerable<int> InstanceID, IEnumerable<string> Commands)
    {
        this.InstanceID = InstanceID.ToList();
        this.Commands = Commands.ToList();
        Configure();
    }
    public static string CleanString(string Str)
    {
        while(Str[0] == ' ')
        {
            Str = Str.Remove(0,1);
        }
        while(Str.Last() == ' ')
        {
            Str = Str.Remove(Str.Length-1);
        }
        return Str;
    }
    private bool GetTerminalToken(List<InstanceDefinition> Defs)
    {
        this.Terminals = new Dictionary<string, Action>();
        var AddTS = new List<string>();
        foreach (var Def in Defs)
        {
            var Tokens = Def.GetUserString("TransformToken").Split(',').ToList();
            if (Tokens.Count != 0)
        {
            foreach (var Token in Tokens)
            {
                var TSstring = Def.GetUserString(Token);
                
                if (TSstring == null) continue; // Null check for TSstring

                if (Terminals.ContainsKey(Token) && !AddTS.Contains(TSstring))
                {
                    cmd += "Duplicate token with different TSstring";
                    return false; // Duplicate token with different TSstring
                }
                else if (!Terminals.ContainsKey(Token))
                {
                    try
                    {
                        var TS = JsonSerializer.Deserialize<Transform>(TSstring);
                        
                        this.Terminals.Add(
                            Token,
                            (ref Transform x) =>
                            {
                                x = x * TS;
                                return true;
                            }
                        );
                        AddTS.Add(TSstring);
                    }
                    catch (JsonException ex)
                    {
                        cmd += $"Failed to deserialize Transform for token '{Token}': {ex.Message}";
                        return false; // Handle deserialization error
                    }
                }
            }
        }
            var NameToken = Def.GetUserString("Name");
            if (NameToken != null && !Terminals.ContainsKey(NameToken))
            {
                this.Terminals.Add(
                    NameToken,
                    (ref Transform x) =>
                    {
                        var ID = RhinoDoc.ActiveDoc.InstanceDefinitions.Find(NameToken);
                        if (ID != null)
                        {
                            RhinoDoc.ActiveDoc.Objects.AddInstanceObject(ID.Index, x);
                            return true;
                        }
                        return false; // Return false if the ID is not found
                    }
                );
            }
        }
        return true;
    }
    private bool GetNonterminalToken()
    {
        Nonterminals = new List<(string, string)>();
        for(int i = 0; i < this.Commands.Count; i++)
        {
            string Code = this.Commands[i];
            if(Code.Contains("//") || Code.Contains("#")) continue;
            if(Code.Contains("="))
            {
                string Head = CleanString(Code.Split('=')[0]);
                if(Code.Split('=')[1].Contains("="))
                {
                    cmd += "two or more = ";
                    return false;
                }
                if(Code.Contains("|"))
                {
                    string[] Bodies = Code.Split('=')[1].Split('|');
                    foreach (var body in Bodies)
                    {
                        this.Nonterminals.Add((Head, CleanString(body)));
                    }
                }
                else
                {
                    this.Nonterminals.Add((Head, CleanString(Code.Split('=')[1])));
                }
            }
        }
        if(Nonterminals.Count == 0)
        {
            cmd += "No nonterminals are set";
             return false;
        }
        return true;
    }
    private bool RunDefined()
    {
        foreach (var Code in Commands)
        {
            if(Code.Contains("#Defined"))
            {
                var SplitsElement = Code.Split(' ');
                if(SplitsElement.Length != 3)
                {
                    cmd += Code + " has error";
                    return false;
                }
                var NewNonterminals = new List<(string, string)>();
                for(int i = 0; i < this.Nonterminals.Count;i++)
                {
                    var Content = this.Nonterminals[i].Item2;
                    if(Content.Contains(SplitsElement[1]));
                        Content = Content.Replace(SplitsElement[1], SplitsElement[2]);
                    NewNonterminals.Add((this.Nonterminals[i].Item1, Content));
                }           
                this.Nonterminals = NewNonterminals;
            }
        }
        return true;
    }
    private bool ReConfigureNonterminalContent()
    {
        var TempList = new List<(string,string)>();
        foreach (var Code in this.Nonterminals)
        {
            var Content = Code.Item2;
            var Tokens = Content.Split(' ');
            var NewList = new List<string>();
            for(int k = 0; k <Tokens.Length; k++)
            {
                var Token = Tokens[k];
                if( int.TryParse(Token, out var N))
                {
                    if(N > 0)
                    {
                        k++;
                        Token = Tokens[k];
                        for(int i = 0; i < N;i++)
                            NewList.Add(Token);
                    }
                }
                else
                    NewList.Add(Token);
            }
            Content = string.Join(" ", NewList);
            TempList.Add((Code.Item1, Content));
        }
        this.Nonterminals = TempList;
        return true;
    }
    private bool Configure()
    {
        var Doc = Rhino.RhinoDoc.ActiveDoc;
        var InstanceObjects = new List<InstanceDefinition>();
        for(int i = 0; i < Doc.InstanceDefinitions.Count ; i++)
        {
            if(InstanceID.Contains(i))
                InstanceObjects.Add(Doc.InstanceDefinitions[i]);
        }
        if(!GetTerminalToken(InstanceObjects))
        {
            cmd += "Terminal failed";
            return false;
        }
        if(!GetNonterminalToken())
        {
            cmd += "Nonterminal failed";
            return false;
        }
        if(!RunDefined()) 
        {
            cmd += "Defined Error";
            return false;
        }
        ReConfigureNonterminalContent();

        cmd += "Configure finished\n==================================\n";
        return true;
    }
    private string RandomPick(IEnumerable<string> Strs)
    {
        var Rand = new Random(System.DateTime.Today.Millisecond);
        return Strs.ToList()[Rand.Next(Strs.ToList().Count)-1];
    }
    private string Space = " ";
    private bool Recurvsive(string Axiom, ref Transform Position)
    {
        var Contents = this.Nonterminals.Where(x => x.Item1 == Axiom).Select(x => x.Item2).ToList();
        if(Contents.Count == 0)
        {
            cmd += $"Cannot find {Axiom}";
            return false;
        }
        var CurrentContent = Contents.Count > 1 ? RandomPick(Contents) : Contents[0];

        var AxiomTokens = CurrentContent.Split(' ');
        var NonterminalsHeads = this.Nonterminals.Select(x => x.Item1 ).ToList();
        cmd += Space + $"{Axiom} : \n";
        foreach(var Token in AxiomTokens)
        {
            if(NonterminalsHeads.Contains(Token))
            {
                Space += " ";
                Recurvsive(Token, ref Position);
                Space = Space.Remove(Space.Length - 1);
            }
            else if(this.Terminals.ContainsKey(Token))
            {
                Space += "   ";
                cmd += Space + $"{Token}\n";
                var ActionResult = Terminals[Token](ref Position);
                Space = Space.Remove(Space.Length - 3);
            }
            
        }
        return true;
    }
    public bool Compute(string Axiom, Transform StartPosition = new Transform())
    {
        Transform InitialTransform = Transform.Identity;
        if(!(StartPosition == new Transform()))
            InitialTransform = StartPosition;

        var Contents = this.Nonterminals.Where(x => x.Item1 == Axiom).Select(x => x.Item2).ToList();
        if(Contents.Count == 0)
        {
            cmd += $"Cannot find {Axiom}";
            return false;
        }
        var CurrentContent = Contents.Count > 1 ? RandomPick(Contents) : Contents[0];

        var AxiomTokens = CurrentContent.Split(' ');
        var NonterminalsHeads = this.Nonterminals.Select(x => x.Item1 ).ToList();
        cmd += Space + $"{Axiom} : \n";
        foreach(var Token in AxiomTokens)
        {
            if(NonterminalsHeads.Contains(Token))
            {
                Space += " ";
                Recurvsive(Token, ref InitialTransform);
                Space = Space.Remove(Space.Length - 1);
            }
            else if(this.Terminals.ContainsKey(Token))
            {
                Space += "   ";
                cmd += Space + $"{Token}\n";
                var ActionResult = Terminals[Token](ref InitialTransform);
                Space = Space.Remove(Space.Length - 3);
            }      
        }
        return true;
    }
    private bool RecurvsiveStepbyStep(string Axiom, ref List<(string,Action)> Actions)
    {
        var Contents = this.Nonterminals.Where(x => x.Item1 == Axiom).Select(x => x.Item2).ToList();
        if(Contents.Count == 0)
        {
            cmd += $"Cannot find {Axiom}";
            return false;
        }
        var CurrentContent = Contents.Count > 1 ? RandomPick(Contents) : Contents[0];

        var AxiomTokens = CurrentContent.Split(' ');
        var NonterminalsHeads = this.Nonterminals.Select(x => x.Item1 ).ToList();
        cmd += Space + $"{Axiom} : \n";
        foreach(var Token in AxiomTokens)
        {
            if(NonterminalsHeads.Contains(Token))
            {
                Space += " ";
                RecurvsiveStepbyStep(Token, ref Actions);
                Space = Space.Remove(Space.Length - 1);
            }
            else if(this.Terminals.ContainsKey(Token))
            {
                Space += "   ";
                cmd += Space + $"{Token}\n";
                Actions.Add((Token,Terminals[Token]));
                Space = Space.Remove(Space.Length - 3);
            }
            
        }
        return true;
    }

    public bool ComputeStepbyStep(string Axiom, ref List<(string,Action)> Actions)
    {
        Actions = new List<(string,Action)>();
        var Contents = this.Nonterminals.Where(x => x.Item1 == Axiom).Select(x => x.Item2).ToList();
        if(Contents.Count == 0)
        {
            cmd += $"Cannot find {Axiom}";
            return false;
        }
        var CurrentContent = Contents.Count > 1 ? RandomPick(Contents) : Contents[0];

        var AxiomTokens = CurrentContent.Split(' ');
        var NonterminalsHeads = this.Nonterminals.Select(x => x.Item1 ).ToList();
        cmd += Space + $"{Axiom} : \n";
        foreach(var Token in AxiomTokens)
        {
            if(NonterminalsHeads.Contains(Token))
            {
                Space += " ";
                RecurvsiveStepbyStep(Token, ref Actions);
                Space = Space.Remove(Space.Length - 1);
            }
            else if(this.Terminals.ContainsKey(Token))
            {
                Space += "   ";
                cmd += Space + $"{Token}\n";
                Actions.Add((Token,Terminals[Token]));
                Space = Space.Remove(Space.Length - 3);
            }      
        }
        return true;
    }
    public bool BakeStepByStep(List<(string,Action)> Actions, ref int Iteration, ref Transform TS)
    {
        if(Iteration >= Actions.Count)
            return true; //Done

        var CallAction = Actions[Iteration];
        var Result = CallAction.Item2(ref TS);
        Iteration++;
        return !Result;
    }
}
# ---------- end c_script_16 ----------

# ---- group: Simple Shape Interpreter
c_script_17 = CSharpScript(iRules=merge_4, Axiom="<Axiom>", Bake=button_3, Blocks=merge, RePosition=c_script_11.TS)  # -> out, cmd, Terminal, Nonterminal; inputs iRules: list of String, Axiom: String, Bake: Boolean, Blocks: list of Int32, RePosition: Transform; same code as c_script_16
